# Grasshopper definition udp_only.gh (Grasshopper 1.0.8)
# plug-ins: Virtual Robot, Vizor

# Task Info Receiver (UDP)
panel = Panel("127.0.0.1")
async_udp_receiver = Python3Script(host=panel, port="5006", reset=Button(), run=Toggle(False))  # -> out, msg, raw, last_update_time; inputs host: String, port: Int32, reset: Boolean, run: Boolean
#   port host: The IP address to bind to (e.g., "127.0.0.1").
#   port port: The network port to listen on (e.g., 5006).
#   port reset: Toggle to forcefully close the socket, kill the thread, and clear the memory cache.
#   port run: Set to True to open the port and start the background listening thread.
#   port msg: The successfully parsed JSON dictionary from the incoming packet.
#   port raw: The raw, unparsed UTF-8 text string of the incoming packet.
#   port last_update_time: The exact millisecond timestamp (HH:MM:SS.mmm) when the background thread received the packet.
# ---------- async_udp_receiver: Python ----------
import datetime
import json
import socket
import threading

import scriptcontext as sc
import Grasshopper as gh

SOCKET_KEY = "udp_receiver_socket_{}".format(port)
THREAD_KEY = "udp_receiver_thread_{}".format(port)
STOP_EVENT_KEY = "udp_stop_event_{}".format(port)
LAST_MSG_KEY = "udp_receiver_last_msg_{}".format(port)
LAST_RAW_KEY = "udp_receiver_last_raw_{}".format(port)
LAST_TIME_KEY = "udp_receiver_last_time_{}".format(port)
NEW_FLAG_KEY = "udp_new_message_flag_{}".format(port) # <-- NEW KEY ADDED


# ---------------------------------------------------------
# 1. CLEANUP / RESET LOGIC
# ---------------------------------------------------------
def stop_listening():
    """Signals the background thread to stop and closes the socket."""
    if STOP_EVENT_KEY in sc.sticky:
        sc.sticky[STOP_EVENT_KEY].set() # Tell the thread loop to break
    
    if SOCKET_KEY in sc.sticky:
        try:
            sc.sticky[SOCKET_KEY].close()
        except:
            pass
        del sc.sticky[SOCKET_KEY]


# ---------------------------------------------------------
# 2. BACKGROUND THREAD LOGIC
# ---------------------------------------------------------
def trigger_grasshopper(doc):
    """Callback function executed on the main UI thread to recompute this component."""
    ghenv.Component.ExpireSolution(False)

def udp_listen_loop(stop_event, sock, ghdoc):
    """The infinite loop that runs on the background thread."""
    while not stop_event.is_set():
        try:
            # Blocks for 0.5 seconds waiting for data. 
            # If no data, it throws a timeout error, letting us check stop_event.
            data, addr = sock.recvfrom(4096)
            
            arrival_time = datetime.datetime.now().strftime("%H:%M:%S.%f")[:-3] 
            sc.sticky[LAST_TIME_KEY] = arrival_time

            raw_text = data.decode("utf-8")
            try:
                msg = json.loads(raw_text)
            except ValueError:
                msg = {} # Fallback if JSON is malformed
                
            # Store data globally
            sc.sticky[LAST_RAW_KEY] = raw_text
            sc.sticky[LAST_MSG_KEY] = msg
            
            # --- FLAG SET TO TRUE BEFORE TRIGGERING GRASSHOPPER ---
            sc.sticky[NEW_FLAG_KEY] = True 
            
            # Tell Grasshopper to wake up and recompute this component!
            if ghdoc:
                ghdoc.ScheduleSolution(1, gh.Kernel.GH_Document.GH_ScheduleDelegate(trigger_grasshopper))
                
        except socket.timeout:
            # Normal behavior when no messages are coming in. Loop continues.
            pass
        except socket.error as e:
            # Socket was likely closed via the reset toggle
            break


# ---------------------------------------------------------
# 3. INITIALIZATION
# ---------------------------------------------------------
# Ensure the flag exists in memory
if NEW_FLAG_KEY not in sc.sticky:
    sc.sticky[NEW_FLAG_KEY] = False

if run:
    if SOCKET_KEY not in sc.sticky:
        sock = socket.socket(socket.AF_INET, socket.SOCK_DGRAM)
        sock.bind((host, port))
        
        # Crucial: Instead of setblocking(False), we use a timeout.
        # This prevents the thread from locking up Rhino when we want to close it.
        sock.settimeout(0.5) 
        
        stop_event = threading.Event()
        
        sc.sticky[SOCKET_KEY] = sock
        sc.sticky[STOP_EVENT_KEY] = stop_event
        
        # Get the current GH document so the thread knows what to update
        ghdoc = ghenv.Component.OnPingDocument()
        
        # Start the background thread
        ghenv.Component.Message = "Listening on thread:\nHost: {}\nPort: {}".format(host, port)
        t = threading.Thread(target=udp_listen_loop, args=(stop_event, sock, ghdoc))
        t.daemon = True # Ensures the thread dies if Rhino closes
        t.start()
        sc.sticky[THREAD_KEY] = t
else:
    stop_listening()
    ghenv.Component.Message = ""

if reset:
    stop_listening()
    sc.sticky[LAST_MSG_KEY] = {}
    sc.sticky[LAST_RAW_KEY] = None
    sc.sticky[NEW_FLAG_KEY] = False # Force flag to false on manual reset
    last_update_time = None

# ---------------------------------------------------------
# 4. MAIN COMPONENT OUTPUT LOGIC
# ---------------------------------------------------------
is_new_message = sc.sticky.get(NEW_FLAG_KEY, False)

if is_new_message:
    # A real packet triggered this update. Process the outputs.
    msg = sc.sticky.get(LAST_MSG_KEY, {})
    raw = sc.sticky.get(LAST_RAW_KEY, None)
    last_update_time = sc.sticky.get(LAST_TIME_KEY, None)
    
    # Immediately consume the flag so next UI click doesn't trigger output
    sc.sticky[NEW_FLAG_KEY] = False 
else:
    # A user clicked a toggle. Block the outputs to protect the robot.
    msg = None
    raw = None
# ---------- end async_udp_receiver ----------
panel_2 = Panel(async_udp_receiver.msg)
udp_message_parser = Python3Script(msg=async_udp_receiver.msg)  # -> out, step_id, step_progress
# ---------- udp_message_parser: Python ----------
import Grasshopper as gh

# 1. Set default fallback values to ensure old data doesn't linger
step_id = None
step_progress = None

# 2. Safely parse the message
if isinstance(msg, dict):
    step_id = msg.get("step_id", None)
    step_progress = msg.get("progress", None)

# 3. (Optional but recommended) Warn the user if the input is wrong
elif msg is not None:
    ghenv.Component.AddRuntimeMessage(
        gh.Kernel.GH_RuntimeMessageLevel.Warning, 
        "Input 'msg' must be a dictionary. Check your UDP output."
    )
# ---------- end udp_message_parser ----------
process_model_output = Python3Script(
    step_id=udp_message_parser.step_id,
    task_progress=udp_message_parser.step_progress,
    human_proc_speed=Slider(3.12, range=0..10))  # -> out, robot_state, robot_ave_speed; inputs step_id: Int32, task_progress: Double, human_proc_speed: Double
# ---------- process_model_output: Python ----------
import Grasshopper as gh

STATE_MAP_DICT = {
    0: {"rob_state_option": (0, 1), "task_proc_threshold": 0.01}, # moving a spacer
    1: {"rob_state_option": (2,), "task_proc_threshold": 1.00}, # adjusting
    2: {"rob_state_option": (2, 3), "task_proc_threshold": 0.66}, # fixing
    3: {"rob_state_option": (0, 1), "task_proc_threshold": 0.80}, # connection
}

ROB_SPEED_OPTION = {
    "low" : 50,
    "medium": 125,
    "high": 200
}


def find_robot_state(step_id, taks_progress):
    
    state_dict = STATE_MAP_DICT[step_id]
    if taks_progress > state_dict['task_proc_threshold']:
        rob_state = state_dict["rob_state_option"][1]
    else:
        rob_state = state_dict["rob_state_option"][0]
    
    return rob_state

def adj_rob_speed(human_proc_speed):
    
    if human_proc_speed < 1.0:
        rob_speed = ROB_SPEED_OPTION['low']
    elif human_proc_speed < 3.0:
        rob_speed = ROB_SPEED_OPTION['medium']
    else:
        rob_speed = ROB_SPEED_OPTION['high']
    
    return rob_speed

if isinstance(step_id, int) & isinstance(task_progress, float):
    robot_state = find_robot_state(step_id, task_progress)
    robot_ave_speed = adj_rob_speed(human_proc_speed)
else:
    ghenv.Component.AddRuntimeMessage(
        gh.Kernel.GH_RuntimeMessageLevel.Warning, 
        "input (step_id and task_progress) is not correct."
    )
# ---------- end process_model_output ----------
data = Data(Tree({0;0}: [Plane(origin=(-150, 650, 500), x=(1, 0, 0), y=(0, -1, 0))], {0;1}: [Plane(origin=(-150, 650, 500), x=(1, 0, 0), y=(0, -1, 0)), Plane(origin=(0, 700, 458), x=(0, -1, 0), y=(-1, 0, 0)), Plane(origin=(0, 700, 258), x=(0, -1, 0), y=(-1, 0, 0)), Plane(origin=(0, 700, 158), x=(0, -1, 0), y=(-1, 0, 0))], {0;2}: [Plane(origin=(0, 700, 158), x=(0, -1, 0), y=(-1, 0, 0))], {0;3}: [Plane(origin=(0, 700, 158), x=(0, -1, 0), y=(-1, 0, 0)), Plane(origin=(0, 700, 258), x=(0, -1, 0), y=(-1, 0, 0)), Plane(origin=(0, 700, 458), x=(0, -1, 0), y=(-1, 0, 0)), Plane(origin=(53.92068206, 540.1767684, 773.6520519), x=(-0.4420113276, -0.5579886724, -0.702335125), y=(-0.5579886724, -0.4420113276, 0.702335125)), Plane(origin=(116.4593565, 354.809435, 1139.753892), x=(-1, 0, 0), y=(0, -1, 0)), Plane(origin=(116.4593565, 354.809435, 1239.753892), x=(-1, 0, 0), y=(0, -1, 0))], {0;4}: [Plane(origin=(116.4593565, 354.809435, 1239.753892), x=(-1, 0, 0), y=(0, -1, 0))], {0;5}: [Plane(origin=(116.4593565, 354.809435, 1239.753892), x=(-1, 0, 0), y=(0, -1, 0))], {0;6}: [Plane(origin=(116.4593565, 354.809435, 1239.753892), x=(-1, 0, 0), y=(0, -1, 0)), Plane(origin=(116.4593565, 354.809435, 1139.753892), x=(-1, 0, 0), y=(0, -1, 0)), Plane(origin=(-36.07405333, 497.0912873, 831.392516), x=(-0.05651853448, 0, 0.9984015501), y=(0, -1, 0)), Plane(origin=(-150, 650, 500), x=(1, 0, 0), y=(0, -1, 0))], {0;7}: [Plane(origin=(116.4593565, 354.809435, 1239.753892), x=(-1, 0, 0), y=(0, -1, 0))]))

# ----
# Robot Path Template Selection Layer
teach_mode = Panel("""False
False
False
False
False
False
False
True""")
gripper_state = Panel("""False
False
True
True
True
False
False
False""")
robot_state = Integer(Slider(4, range=0..10))
retreive_action_list_joint = Python3Script(robot_state=robot_state, robot_joints=data, gripper_state_list=gripper_state, mode_state_list=teach_mode)  # -> out, actions, action_joints, gripper_states, teach_mode; inputs robot_joints: tree, gripper_state_list: list of Boolean, mode_state_list: list
# ---------- retreive_action_list_joint: Python ----------
from ghpythonlib import treehelpers as th

ACTION_MAP_DICT = {
    0: (0,),
    1: (1, 2, 3),
    2: (7,),
    3: (4,),
    4: (5, 6),
}

ACTION_LIST = {
    0: "pause",
    1: "approch",
    2: "pick up",
    3: "place",
    4: "hold",
    5: "release",
    6: "move to home",
    7: "freedrive"
    }

def find_action(state, planes, gripper_state_list, mode_state_list):

    action_ids = ACTION_MAP_DICT[state]
    actions = [[ACTION_LIST[i]] for i in action_ids]
    action_planes = [planes[i] for i in action_ids]
    gripper_states = [[gripper_state_list[i]] for i in action_ids]
    teach_mode = list(set([mode_state_list[i] for i in action_ids]))

    return action_planes, gripper_states, actions, teach_mode

def convert_tree_to_list(tree_data):
    return [[v for v in tree_data.Branch(path)] for path in tree_data.Paths]

planes_list = th.tree_to_list(robot_joints)
action_joints, gripper_states, actions, teach_mode = find_action(robot_state, planes_list, gripper_state_list, mode_state_list)
action_joints = th.list_to_tree(action_joints)
gripper_states = th.list_to_tree(gripper_states)
actions = th.list_to_tree(actions)
# ---------- end retreive_action_list_joint ----------
panel_3 = Panel(retreive_action_list_joint.action_joints)
panel_4 = Panel(retreive_action_list_joint.actions)

xy_plane = XYPlane(Origin=Point(0, 0, 0))
move = Move(Geometry=xy_plane, Motion="{0,0,157.5}")  # -> Geometry, Transform

# ---- group: Open
mesh = Mesh(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)

# ----
# Robot Definition
# (Gripper Model)
# ROBOT KINEMATICS
# [unit: mm]
open_gripper = BooleanToggle(False)
mesh_2 = Mesh(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)
stream_filter = StreamFilter(Gate=open_gripper, Stream0=mesh, Stream1=mesh_2)
define_end_effector = DefineEndEffector(Geometry=stream_filter, TCPFrame=move.Geometry, MountingFrame=PlaneXY(0, 0, 0))
xy_plane_2 = XYPlane(Origin=Point(0, 0, 0))
predefined_universal_robot_ur10 = PredefinedUniversalRobotUR10(BaseFrame=xy_plane_2, EndEffectorOptional=define_end_effector)
merge = Merge(Data1=Toggle(False), Data2=Toggle(False), Data3=Toggle(True))

wsconnection = WsConnection(Address="ws://localhost:9090", Reset=Button())  # -> WebsocketObject, ConnectionInfo

# ----
# ROS Publisher
# (Gripper, Speed control, Teach Mode)
# local_accel: joint acceleration of leading axis [rad/s^2]
# local_speed: joint speed of leading axis [rad/s]
# Gripper Control
number_slider = Slider(3.14, range=0..100)
number_slider_2 = Slider(1.5, range=0..3)
gripper_state_2 = BooleanToggle(False)
send = Button()
gripper_state_3 = BooleanToggle(False)
send_2 = Button()
send_3 = Button()
publish_topic = PublishTopic(
    WSC=wsconnection.WebsocketObject,
    TopicName="Robot/teachMode",
    Message=gripper_state_2,
    Publish=send_2,
    MessageType="std_msgs/Bool")
publish_topic_2 = PublishTopic(
    WSC=wsconnection.WebsocketObject,
    TopicName="Robot/gripper",
    Message=gripper_state_3,
    Publish=send_3,
    MessageType="std_msgs/Bool")
publish_topic_3 = PublishTopic(
    WSC=wsconnection.WebsocketObject,
    TopicName="Robot/localSpeed",
    Message=number_slider,
    Publish=send,
    MessageType="std_msgs/Float64")
publish_topic_4 = PublishTopic(
    WSC=wsconnection.WebsocketObject,
    TopicName="Robot/localAccel",
    Message=number_slider,
    Publish=send,
    MessageType="std_msgs/Float64")
panel_5 = Panel(publish_topic_2)
panel_6 = Panel(publish_topic_3)

# ----
# Robot Setup(Vizor)
links = Panel("""new_ur10_nogripper
base_link
base_link_inertia
shoulder_link
upper_arm_link
forearm_link
wrist_1_link
wrist_2_link
wrist_3_link
flange""")
panel_7 = Panel(merge)
robot = Robot(
    WebsocketObject=wsconnection.WebsocketObject,
    Disable=Toggle(False),
    RobotName="UR10",
    VirtualRobotModelNS=predefined_universal_robot_ur10,
    AxisToggles=panel_7,
    JointNames=links)  # -> Output, RobotObject

# ----
# Remove duplicate planes (for visuzalization)
flatten_tree = FlattenTree(Tree=retreive_action_list_joint.action_joints, Path="{0}")
removeduplicatepts = RemoveDuplicatePts(Points=flatten(flatten_tree), Tolerance=0.01)
point = Point(flatten_tree)
find_similar_member = FindSimilarMember(Data=removeduplicatepts, Set=point)  # -> Hit, Index
list_item = ListItem(List=flatten_tree, Index=find_similar_member.Index, Wrap=True)

# ----
# Robot Motion Visualization
number_slider_3 = Slider(0.01, range=0.01..0.99)
interpolate_frames = InterpolateFrames(Length=number_slider_3, Step="1", Reset=Toggle(True))  # -> Frame, Percent, CurrentIndex
panel_8 = Panel(list_item)
panel_9 = Panel(merge)
robot_inverse_kinematics = RobotInverseKinematics(
    Robot=predefined_universal_robot_ur10,
    TargetTCPFrame=interpolate_frames.Frame,
    AxisToggles=panel_9,
    useColorPreview=True)  # -> PoseGeometry, AxisValues, AxisFrames
joint_position_degree = Panel(robot_inverse_kinematics.AxisValues)
joint_position_degree_2 = Panel()
subtraction = Subtraction(A=joint_position_degree, B=joint_position_degree_2)
absolute = Absolute(Value=subtraction)
angle_difference = Panel(subtraction)

# ----
# Trajectory from Vizor [mm]
inverse_transform = InverseTransform()
transform = Transform(Transform=inverse_transform)

panel_10 = Panel(interpolate_frames.CurrentIndex)

# ----
# Piece visualization
orient = Orient(Source=PlaneXY(0, 0, 0), Target=interpolate_frames.Frame)  # -> Geometry, Transform
